# Grasshopper definition Curve_Divide_hops.gh (Grasshopper 1.0.7)

L = GetLine(AtLeast=1, AtMost=1, Realtime=True)
midpoint = Slider(0.5, range=0..1)
A = GetNumber(AtLeast=1, AtMost=1, Maximum=1.797693135e+308, Minimum=-1.797693135e+308)
divide = DivideCurve(Curve=reparameterize(L), Count=3, Kinks=False)  # -> Points, Tangents, Parameters
eval = EvaluateCurve(Curve=reparameterize(L), Parameter=midpoint)  # -> Point, Tangent, Angle
rad = Radians(Degrees=90)
Z = UnitZ(Factor=1)
vrot = Rotate(Vector=eval.Tangent, Axis=Z, Angle=rad)
amp = Amplitude(Vector=vrot, Amplitude=A)
move = Move(Geometry=eval.Point, Motion=amp)  # -> Geometry, Transform
ins = InsertItems(List=divide.Points, Item=move.Geometry, Indices=2, Wrap=True)
pline = PolyLine(Vertices=ins, Closed=False)
explode = Explode(Curve=pline, Recursive=True)  # -> Segments, Vertices

# ---- group: RH_OUT:P
line = Line(explode.Segments)
