# Grasshopper definition Hops_test.gh (Grasshopper 1.0.7)

get_number = GetNumber(AtLeast=1, AtMost=1, Maximum=1.797693135e+308, Minimum=-1.797693135e+308)
get_number_2 = GetNumber(AtLeast=1, AtMost=1, Maximum=1.797693135e+308, Minimum=-1.797693135e+308)
addition = Addition(A=get_number, B=get_number_2)

# ---- group: RH_OUT:NUM
num = Number(addition)
